# Dynamo graph 2023_COPY FILTERS FROM VIEW.dyn "ORI_R2023_COPY FILTERS FROM VIEW" (Dynamo 2.13.1.3887)
# packages: archi-lab.net 2023.213.1523, Data-Shapes 2022.2.103, Clockwork for Dynamo 2.x 2.4.0

# group: 1. Get All Views in the Project
categories = Categories("OST_Views")
all_elements_of_category = ElementsOfCategory(Category=categories)

# group: 2. Remove Null Views
isNull = Object.IsNull(object=all_elements_of_category)
filterByBoolMask = List.FilterByBoolMask(list=all_elements_of_category, mask=isNull)

# group: 3. Remove View Templates
isViewTemplate = Custom[View.IsViewTemplate+](view=filterByBoolMask.out)  # package Clockwork for Dynamo 2.x; Checks if a given view is a view template. Unlike the OOTB node it works for all view types.
filterByBoolMask_2 = List.FilterByBoolMask(list=filterByBoolMask.out, mask=isViewTemplate)

# group: 4. Check if Views have Filters Applied
# note: Custom Node: Clockwork
usesViewFilters = Custom[View.UsesViewFilters](view=filterByBoolMask_2.out)  # package Clockwork for Dynamo 2.x; Checks if a given view has any view filters applied to it.
filterByBoolMask_3 = List.FilterByBoolMask(list=filterByBoolMask_2.out, mask=usesViewFilters)

# group: 5. Views with Filters Drop Down UI
code_block = CodeBlock { "Select View with Filters"; }
name = Element.Name(element=filterByBoolMask_3.in)
# note: Custom Node: Data-Shapesv.2022.2.103
dropdown_data = Custom[DropDown Data](InputName=code_block, Keys=name, Values=filterByBoolMask_3.in)  # package Data-Shapes; Create data for DropDown input in UI.MultiInputForm ++ . Check out www.data-shapes.net for more infos.

# group: 6. All Views List View UI
code_block_2 = CodeBlock { "Select Views to Apply Filters"; 500; false; }
name_2 = Element.Name(element=filterByBoolMask_2.out)
# note: Custom Node: Data-Shapesv.2022.2.103
listview_data = Custom[Listview Data](InputName=code_block_2.out0, Keys=name_2, Values=filterByBoolMask_2.out, Height_optionnal=code_block_2.out1, ShowId_optionnal=code_block_2.out2)  # package Data-Shapes; Create data for ListView input in UI.MultiInputForm ++ . Check out www.data-shapes.net for more infos.

# group: 7. Main UI Window
code_block_3 = CodeBlock { "Apply View Filters (Even if View Template Applied)"; "Apply"; "Cancel"; 250; 600; }
list_create = List.Create(item0=dropdown_data, item1=listview_data)
boolean = BoolSelector(true)
# note: Custom Node: Data-Shapesv.2022.2.103
multipleinputform = Custom[MultipleInputForm ++](Description_optional=code_block_3.out0, ButtonText_optional=code_block_3.out1, Inputs=list_create, Toggle=boolean, CancelButtonText_optional=code_block_3.out2, Width_optional=code_block_3.out4, LabelWidth_optional=code_block_3.out3)  # package Data-Shapes; Create a form with multiple inputs. see www.data-shapes.net for tutorials and infos!

# group: 8. Set View Filters
code_block_4 = CodeBlock(x=multipleinputform.User_Inputs) { x[0]; x[1]; }
filters = View.Filters(view=code_block_4.out0)
# note: Custom Node: archilab
filterOverrides = archilab.Revit.Views.Views.FilterOverrides(view=code_block_4.out0, parameterFilter=filters)
setFilterOverrides = archilab.Revit.Views.Views.SetFilterOverrides(views=code_block_4.out1, viewFilter=filters, overrides=filterOverrides)
