# Dynamo graph 2023_Change Specified Parameter on Multiple Sheets.dyn "ORI_R2023_CHANGE PARAMETERS ON MULTIPLE SHEETS - A KI" (Dynamo 2.13.1.3887)
# author: Revit Dynamo | Andrey Kim
# Change Specified Parameter on Multiple Sheets
# packages: Data-Shapes 2022.2.103

# group: Get All Sheets in the Project
categories = Categories("OST_Sheets")
all_elements_of_category = ElementsOfCategory(Category=categories)

# group: Get Sheet Names and Numbers
sheetNumber = Sheet.SheetNumber(sheet=all_elements_of_category)
sheetName = Sheet.SheetName(sheet=all_elements_of_category)
code_block = CodeBlock(a=sheetNumber, b=sheetName) { a + " - " + b; }

# group: Select Elements Input Values
code_block_2 = CodeBlock { "All Sheets"; 300; }
boolean = BoolSelector(true)
boolean_2 = BoolSelector(false)
# note: Custom Node: Data-Shapesv.2022.2.103
listview_data = Custom[Listview Data](InputName=code_block_2.out0, Keys=code_block, Values=all_elements_of_category, Height_optionnal=code_block_2.out1, HilightInView_optionnal=boolean, DisplayModeOnly_optionnal=boolean_2, ShowElementCount_optionnal=boolean, SortItems_optionnal=boolean, ShowId_optionnal=boolean_2)  # package Data-Shapes; Create data for ListView input in UI.MultiInputForm ++ . Check out www.data-shapes.net for more infos.

# group: Select Parameter Input Value
code_block_3 = CodeBlock { "Select Parameter"; }
firstItem = List.FirstItem(list=all_elements_of_category)
parameters = Element.Parameters(element=firstItem)
isReadOnly = Parameter.IsReadOnly(parameter=parameters)
filterByBoolMask = List.FilterByBoolMask(list=parameters, mask=isReadOnly)
name = Parameter.Name(parameter=filterByBoolMask.out)
boolean_3 = BoolSelector(true)
# note: Custom Node: Data-Shapesv.2022.2.103
dropdown_data = Custom[DropDown Data](InputName=code_block_3, Keys=name, Values=name, Sorted_optional=boolean_3)  # package Data-Shapes; Create data for DropDown input in UI.MultiInputForm ++ . Check out www.data-shapes.net for more infos.

# group: New Input Value
code_block_4 = CodeBlock { "Type New Value"; }
boolean_4 = BoolSelector(false)
# note: Custom Node: Data-Shapesv.2022.2.103
textbox_data = Custom[TextBox Data](InputName=code_block_4, IsNumberEntry=boolean_4)  # package Data-Shapes; Create Data for TextBox input in UI.MultipleInputForm ++ . Check out www.data-shapes.net for more informations

# group: UI Window
code_block_5 = CodeBlock { "Apply Changes"; "Cancel"; "Set New Parameters"; }
list_create = List.Create(item0=listview_data, item1=dropdown_data, item2=textbox_data)
boolean_5 = BoolSelector(true)
code_block_6 = CodeBlock { 850; 300; 200; }
# note: Custom Node: Data-Shapesv.2022.2.103
multipleinputform = Custom[MultipleInputForm ++](Description_optional=code_block_5.out2, ButtonText_optional=code_block_5.out0, Inputs=list_create, Toggle=boolean_5, CancelButtonText_optional=code_block_5.out1, MaxHeight_optional=code_block_6.out0, Width_optional=code_block_6.out1, LabelWidth_optional=code_block_6.out2)  # package Data-Shapes; Create a form with multiple inputs. see www.data-shapes.net for tutorials and infos!

# group: Set Parameter Values
code_block_7 = CodeBlock(x=multipleinputform.User_Inputs) { x[0]; x[1]; x[2]; }
setParameterByName = Element.SetParameterByName(element=code_block_7.out0, parameterName=code_block_7.out1, value=code_block_7.out2, lacing=Longest)
