# Dynamo graph 2023_GET INFORMATION FROM LINKED ELEMENTS.dyn "ORI_R2023_GET INFORMATION FROM LINKED ELEMENTS" (Dynamo 2.13.1.3887)
# packages: bimorphNodes 4.2.1, Rhythm 2022.7.2, archi-lab.net 2023.213.1523

# group: Add Headers
code_block = CodeBlock()
# ---------- code_block.designscript (6 lines) ----------
"Linked Element ID";
"Linked Element Mark";
"Linked Element System Type";
"Intersecting Element Name";
"Intersecting Element Type Mark";
"Intersecting Element ID";
# ----------------------------------------
list_create = List.Create(item0=code_block.out0, item1=code_block.out1, item2=code_block.out2, item3=code_block.out3, item4=code_block.out4, item5=code_block.out5)

# group: Get All Linked Elements of Category
# note: Custom Node: Rhythmv.2022.7.2
links = Links("Linked Model.rvt : 1 : location <Not Shared>")  # graph input
linked_elements_category = Categories("OST_DuctCurves")  # graph input
# note: Custom Node: BimorphNodesv.4.2.1
ofCategory = Revit.LinkElement.OfCategory(linkInstance=links, category=linked_elements_category)

# group: Get All Elements of Category
intersecting_elements_category = Categories("OST_Walls")  # graph input
all_elements_of_category = ElementsOfCategory(Category=intersecting_elements_category)

# group: Filter Through All Walls
code_block_2 = CodeBlock { "Type Mark"; }
# note: Custom Node: Rhythmv.2022.7.2
ʳʰʸᵗʰᵐ_elements = Rhythm.Revit.Elements.Elements.GetParameterValueByNameTypeOrInstance(element=all_elements_of_category, parameterName=code_block_2)
# note: Custom Node: archilab
isNullOrEmpty = archilab.Core.Strings.IsNullOrEmpty(str=ʳʰʸᵗʰᵐ_elements)
filterByBoolMask = List.FilterByBoolMask(list=all_elements_of_category, mask=isNullOrEmpty)

# group: Get Intersecting Elements
# note: Custom Node: BimorphNodesv.4.2.1
intersectsElement = Revit.Element.IntersectsElement(elementSetA=ofCategory, elementSetB=filterByBoolMask.out)
element = Results.ElementIntersectionResult.Element(elementIntersectionResult=intersectsElement)
intersectingElements = Results.ElementIntersectionResult.IntersectingElements(elementIntersectionResult=intersectsElement)

# group: Remove Non-Intersecting Elements
isEmpty = List.IsEmpty(list=intersectingElements, lacing=Longest)
filterByBoolMask_2 = List.FilterByBoolMask(list=element, mask=isEmpty)
filterByBoolMask_3 = List.FilterByBoolMask(list=intersectingElements, mask=isEmpty)

# group: Get Linked Elements Parameters Values
id = Element.Id(element=filterByBoolMask_2.out)
code_block_3 = CodeBlock { "Mark"; }
# note: Custom Node: BimorphNodesv.4.2.1
getParameterValueByName = Revit.LinkElement.GetParameterValueByName(linkElement=filterByBoolMask_2.out, parameterName=code_block_3)
code_block_4 = CodeBlock { "System Type"; }
getParameterValueByName_2 = Revit.LinkElement.GetParameterValueByName(linkElement=filterByBoolMask_2.out, parameterName=code_block_4)
name = Element.Name(element=getParameterValueByName_2)

# group: Get Intersecting Elements Parameters Values
flatten = List.Flatten(list=filterByBoolMask_3.out)
name_2 = Element.Name(element=flatten)
code_block_5 = CodeBlock { "Type Mark"; }
# note: Custom Node: Rhythmv.2022.7.2
ʳʰʸᵗʰᵐ_elements_2 = Rhythm.Revit.Elements.Elements.GetParameterValueByNameTypeOrInstance(element=flatten, parameterName=code_block_5)
id_2 = Element.Id(element=flatten)

# group: Combine Data for Excel File
list_create_2 = List.Create(item0=id, item1=getParameterValueByName, item2=name, item3=name_2, item4=ʳʰʸᵗʰᵐ_elements_2, item5=id_2)
transpose = List.Transpose(lists=list_create_2)
addItemToFront = List.AddItemToFront(item=list_create, list=transpose)

# group: Export Excel File
file_path_to_excel_file = Filename("..\..\test\New Microsoft Excel Worksheet.xlsx")  # graph input
code_block_6 = CodeBlock { "Sheet1"; 0; }
boolean = BoolSelector(true)
exportToExcel = Data.ExportToExcel(filePath=file_path_to_excel_file, sheetName=code_block_6.out0, startRow=code_block_6.out1, startColumn=code_block_6.out1, data=addItemToFront, overWrite=boolean, writeAsString=boolean)
