# Dynamo graph 2023_LEGEND BY VIEW FILTERS.dyn "ORI_R2023_LEGEND BY VIEW FILTERS" (Dynamo 2.13.1.3887)
# packages: Genius Loci 2022.6.16, spring nodes 210.1.1

# group: 2. Create Rectangle Shape
code_block = CodeBlock { 1000; 500; }
byWidthLength = Rectangle.ByWidthLength(width=code_block.out0, length=code_block.out1)
curves = PolyCurve.Curves(polyCurve=byWidthLength)

# group: 1. Get Filters from Selected View
select_view_with_filters = Views()  # nothing selected; graph input
# note: Custom Node: GeniusLociv.2022.6.16
get_filter_overrides = Custom[Get Filter Overrides](view=select_view_with_filters)  # package Genius Loci; Get the view filter and its overrides from the given view. Note : Prior to Revit 2019, the materials have only one surface pattern and one cut pattern.

# group: 3. Duplicate Rectangle Shapes
byJoinedCurves = PolyCurve.ByJoinedCurves(curves=curves)
length = Curve.Length(curve=curves)
code_block_2 = CodeBlock(x=length) { x[0]; }
count = List.Count(list=get_filter_overrides.ViewFilterName)
code_block_3 = CodeBlock(x=code_block_2, y=count) { 0..(x*y-x)*(-2)..x*(-2); }
translate = Geometry.Translate(geometry=byJoinedCurves, yTranslation=code_block_3)

# group: 4. Duplicate Existing Filled Region
code_block_4 = CodeBlock { "Solid_Black"; }
byName = FilledRegionType.ByName(name=code_block_4)
# note: Custom Node: spring nodesv.210.1.1
ꟿ_elementtype_duplicate = Custom[ꟿ ElementType.Duplicate](elementType=byName, newName=get_filter_overrides.ViewFilterName)  # package spring nodes; Create duplicate element types. If the type exists, it will be appended instead.

# group: 5. Create New Filled Regions
select_empty_legend_view = Views()  # nothing selected; graph input
curves_2 = PolyCurve.Curves(polyCurve=translate)
byCurves = FilledRegion.ByCurves(view=select_empty_legend_view, boundary=curves_2, regionType=ꟿ_elementtype_duplicate)

# group: 6. Change Colour and Name of New Filled Regions
# note: Custom Node: GeniusLociv.2022.6.16
filledregion_properties_change = Custom[FilledRegion Properties Change](FilledRegion_OrType=byCurves, ForegroundPattern=get_filter_overrides.CutForegroundPattern, ForegroundPatternColor=get_filter_overrides.CutForegroundPatternColor, lacing=Longest)  # package Genius Loci; Assigns Pattern, Color and Line Weight to the given Filled Region or to a Filled Region Type. Note : Prior to Revit 2019, the materials have only one surface pattern and one cut pattern.

# group: 7. Create Tags for each Filled Region
code_block_5 = CodeBlock(x=code_block_3) { 1500; x-165; }
byCoordinates = Point.ByCoordinates(x=code_block_5.out0, y=code_block_5.out1)
byElementAndLocation = Tag.ByElementAndLocation(view=select_empty_legend_view, element=byCurves, location=byCoordinates)
